# Grasshopper definition gh_test.gh (Grasshopper 1.0.7)

# ----
# Select Script
# Filepath
file_path = FilePath("C:\Users\Jonas\bwSyncShare\ITECH2325\04_Seminars\04_02_ComputationalDesign\FinalAssignment\Computational-Design-Assignment\wandering_agents_3D.py")
read_file = ReadFile(File=file_path, PerLineParse=False)

# ----
# In case error: float has no attribute Length
# press reset button a couple of times
button = Button()

trigger = Trigger(Interval=1, TimerInterval=5, Target=ghpython_script)  # disabled
ghpython_script = GhPythonScript(Code=read_file, IReset=button)  # -> Out, OGeometry
messages = Panel(ghpython_script.Out)
